# Grasshopper definition solar_path_main.gh (Grasshopper 1.0.7)

degrees = Slider(22, range=0..89)
minutes = Slider(0, range=0..60)
building_height = Slider(1, range=0..5)
division = Division(A=minutes, B=60)
addition = Addition(A=degrees, B=division)
list = ValueList({"Equinox": 0, "Summer Solstice": 23.45, "Winter Solstice": -23.45}, selected="Equinox")
series = Series(Start=-90, Step=15, Count=12)
c_script = CSharpScript(r=Slider(100, range=0..100), HRA=series, LAT=addition, DEC=list)  # -> out, rs, ds, rsr; inputs r: Double, HRA: Double, LAT: Double, DEC: Double
# ---------- c_script: C# ----------
    double ALT = (Math.Asin((Math.Sin(DEC) * Math.Sin(LAT)) + (Math.Cos(DEC) * Math.Cos(LAT) * Math.Cos(HRA)))*(180 / 3.14159));
    rs = r * Math.Cos(DEC) / (Math.Sin(ALT) + Math.Sin(DEC));
    ds = r * Math.Cos(LAT) / (Math.Sin(LAT) + Math.Sin(DEC));
    rsr = ALT;
# ---------- end c_script ----------
subtraction = Subtraction(A=c_script.rs, B=c_script.ds)
arc = Arc(Plane=PlaneXY(0, 0, 0), Radius=c_script.ds, Angle=Domain(0, 3.141592654))  # -> Arc, Length
panel = Panel(series)
panel_2 = Panel(c_script.rsr)
series_2 = Series(Start=0, Step=1, Count=25)
pt = ConstructPoint(XCoordinate=flatten(series_2), YCoordinate=flatten(c_script.rs), ZCoordinate=0)
